# Requirement set RequirementsComplianceMatrix_TeamElectRAM (R2025a)

## 1 [#1] Estimated Perlinimary Design Time
The Aircraft must go into service in 2035 with systems varified by 2034.

### 1.1 [#5] Estimated Perliminary Systems Timeline
Estimated time to test and verify Aircraft Systems.

### 1.2 [#2] Preliminary Design Timeline
Estimated time to construct and integrate all parts into working aircraft.

#### 1.2.1 [#13] Structures Design
The perliminary geometry of the aircraft and materials used, including estimated timeline and costs.

##### 1.2.1.1 [#14] Storage
It is required that the aircraft is designed to support each passenger bringing a personal bag and a checked bag.

##### 1.2.1.2 [#15] Comfort
Interior designed to optimize passenger comfort with overhead storage and the main walkway being stand-up height.

##### 1.2.1.3 [#16] Passenger Capacity
The Aircraft must seat at least 9 passengers.

#### 1.2.2 [#19] Propultion System
System through which aircraft generates thrust

##### 1.2.2.1 [#38] Engine Power
The aircraft’s engine take-off power must be less than 1200 horsepower.

##### 1.2.2.2 [#39] Engine Design
It is required that the aircraft rely on single or multi-engine configuration.

#### 1.2.3 [#28] Stability and Control System
System to balance aerodynamic forces and pilot inputs to maintain safe controllable flight

##### 1.2.3.1 [#29] VFR and IFR flight with autopilot
The pilot must be able to fly with VFR (Visual Flight Rules) where the pilot can fly from visual navigation and IFR (Instrument Flight Rules) where the pilot can fly relying on instrument navigaton with a systems autopilot.

##### 1.2.3.2 [#47] Cockpit Flight Data and Voice Recorders
Aircraft must be equipped with flight data recorders and cockpit voice recorders.

##### 1.2.3.3 [#48] Controlability
The aircraft must be controllable and maneuverable without requiring exceptional piloting skills.

## 2 [#21] Saftey
Aircraft must meet requirements:
- Be compliant with FAR Code of Regulations Part 36.301.
- Meet FAA Regulations for Certification.
- Must be compliant flying in controlled and uncontrolled airspace

### 2.1 [#24] Part 36.301
Aircraft must be compliant with FAR Code of Regulations Part 36.301

### 2.2 [#26] FAA Regulations
Aircraft must meet FAA Regulations for Certification

### 2.3 [#27] Controlled/Uncontrolled Airspace
Aircraft must be compliant flying in controlled and uncontrolled airspace

### 2.4 [#32] Emergency Maneuvers
Capable of facilitating rapid and safe evacuations in the conditions following an emergency landing.

## 3 [#10] Operating Costs
To be profitable in RAM market it is required that the aircraft have lower direct operating costs when comparable aircraft.

## 4 [#22] Wingspan
Aircraft must have a wingspan that categorizes the aircraft under ICAO Code C (≤ 36 feet).

## 5 [#40] Performance
Performance of different aspcet for the aircraft to meet mission requirements

### 5.1 [#41] Takeoff Distance
The aircraft must be able to takeoff and land within a distance of no greater than 4000 feet.

### 5.2 [#42] Range
The aircraft must have a range of over 300 nautical miles.

### 5.3 [#43] Icing
The aircraft must be capable of flight in known icing conditions.

### 5.4 [#44] Speed
The aircraft shall be capable of traveling at speeds faster than 130 knots.

### 5.5 [#45] Max Takeoff Weight
The aircraft should weigh no more than 19,500 pounds at the maximum takeoff weight.

### 5.6 [#49] Flight Manual
An airplane flight manual must be provided containing applicable performance information.